# Requirement set 02_SYSRS (R2026a)

## 1 [#29] The system must model a real Melbourne road corridor consisting of multiple intersections.
Feature: Intersection

### 1.1 [#2] Each intersection must include standard Australian traffic lights.
Feature: Intersection

### 1.2 [#3] Each intersection must include right‑turn arrows.
Feature: Intersection

### 1.3 [#4] Each intersection must include pedestrian crossings.
Feature: Intersection

### 1.4 [#35] Each intersection must have it own local controller
Feature: Intersection

### 1.5 [#7] Each intersection must detect vehicle presence for straight‑through lanes at each intersection.
Feature: Intersection

### 1.6 [#8] Each intersection must detect vehicle presence for right‑turn lanes at each intersection.
Feature: Intersection

### 1.7 [#9] Each intersection must detect pedestrian button presses.
Feature: Intersection

### 1.8 [#12] Intersection traffic‑light behaviour must adapt dynamically based on vehicle sensors.
Feature: Intersection

### 1.9 [#13] Intersection traffic‑light behaviour must adapt dynamically based on pedestrian requests.
Feature: Intersection

## 2 [#5] The system must include a train crossing between intersections with boom gates and flashing lights.
Feature: Train Crossing

### 2.1 [#38] The train crossing must have its own controller
Feature: Train Crossing

### 2.2 [#6] The system must detect approaching trains using train sensors at the crossing.
Feature: Train Crossing

### 2.3 [#10] Train detection must trigger boom‑gate closure and train warning lights.
Feature: Train Crossing

### 2.4 [#11] Train‑crossing behaviour must operate solely based on train sensor input.
Feature: Train Crossing

### 2.5 [#33] Train must not be allowed to cross in case of issue with controller
Feature: Train Crossing

#### 2.5.1 [#34] In this case it must send fault code to cental node
Feature: Train Crossing

## 3 [#14] The system must coordinate intersections and the train crossing to prevent excessive traffic buildup along the corridor.
Feature: Corridor Coordination

## 4 [#36] The control room must display current status of the corridor
Feature: Central Control

### 4.1 [#16] The system must include a central control node that can adjust intersection phases dynamically.
Feature: Central Control

### 4.2 [#37] Cental control shall not have control over individual lights
Feature: Central Control

### 4.3 [#39] The central control node must have override commands for intersections
Feature: Central Control

## 5 [#18] The system must operate across multiple distributed nodes (minimum five).
Feature: System Structure

### 5.1 [#19] Nodes must communicate using message‑based interactions.
Feature: System Structure

## 6 [#20] The system must support any suitable output hardware (LEDs, LCD, console, etc.).
Feature: Hardware

## 7 [#21] The system must meet real‑time responsiveness requirements appropriate for corridor safety.
Feature: Safety

## 8 [#22] The system must include moderate fault‑tolerance with safe fallback states.
Feature: Safety

## 9 [#23] The system must support node restart behaviour during faults.
Feature: Safety

## 10 [#24] The system must ensure the corridor remains in a safe state during faults.
Feature: Safety

## 11 [#26] The project must include a comprehensive test plan.
Feature: Testing

## 12 [#30] Justifications (Justification)

### 12.1 [#31] (Justification)

### 12.2 [#32] (Justification)