% Simulink data dictionary Architecture_DD.sldd

Var = false
Node_PedLtWestBus = Simulink.Bus()
Node_TrLtWestBus = Simulink.Bus()
Node_PedBtnWestBus = Simulink.Bus()
Node_VehSensWestBus = Simulink.Bus()
WNode_NetBusOut = Simulink.Bus()
WNode_NetBusIn = Simulink.Bus()
Node_TrainBmGtPos = Simulink.Bus()
Node_TrainSensBus = Simulink.Bus()
Node_TrainSigBmGt = Simulink.Bus()
Node_TrainSigBus = Simulink.Bus()
TNode_NetBusOut = Simulink.Bus()
TNode_NetBusIn = Simulink.Bus()
Node_PedLtEastBus = Simulink.Bus()
Node_TrLtEastBus = Simulink.Bus()
Node_VehSensEastBus = Simulink.Bus()
Node_PedBtnEastBus = Simulink.Bus()
ENode_NetBusIn = Simulink.Bus()
ENode_NetBusOut = Simulink.Bus()
CNode_NetBusIn = Simulink.Bus()
CNode_NetBusOut = Simulink.Bus()